# Grasshopper definition Manual Isovist.gh (Grasshopper 0.9.76)

number_slider = Slider(100, range=0..100)
pt = Point(<point referenced from the Rhino model>)
crv = Curve([<curve referenced from the Rhino model> x5])
pt_2 = Point(<point referenced from the Rhino model>)
number_slider_2 = Slider(30, range=0..100)  # disabled
crv_2 = Curve([<curve referenced from the Rhino model> x5])
number_slider_3 = Slider(100, range=0..100)  # disabled
pt_3 = Point(<point referenced from the Rhino model>)  # disabled
crv_3 = Curve([<curve referenced from the Rhino model> x5])  # disabled
cir = Circle(Plane=pt, Radius=Slider(30, range=0..100))
cir_2 = Circle(Plane=pt_2, Radius=Slider(30, range=0..100))
cir_3 = Circle(Plane=pt_3, Radius=number_slider_2)  # disabled
divide = DivideCurve(Curve=cir, Count=Slider(100, range=0..100), Kinks=False)  # -> Points, Tangents, Parameters
divide_2 = DivideCurve(Curve=cir_2, Count=number_slider, Kinks=False)  # -> Points, Tangents, Parameters
ln = Line(StartPoint=pt, EndPoint=divide.Points)  # -> graft(Line)
divide_3 = DivideCurve(Curve=cir_3, Count=number_slider_3, Kinks=False)  # -> Points, Tangents, Parameters; disabled
ln_2 = Line(StartPoint=pt_2, EndPoint=divide_2.Points)
ccx = CurveCurve(CurveA=ln, CurveB=crv)  # -> simplify(Points), ParamsA, ParamsB
ln_3 = Line(StartPoint=pt_3, EndPoint=divide_3.Points)  # disabled
crossref = CrossReference(ListA=ln_2, ListB=crv_2, CrossMode=1)  # -> ListA, ListB
item = ListItem(List=ccx.Points, Index=0, Wrap=True)
crossref_2 = CrossReference(ListA=ln_3, ListB=crv_3, CrossMode=1)  # -> ListA, ListB; disabled
ccx_2 = CurveCurve(CurveA=crossref.ListA, CurveB=crossref.ListB)  # -> Points, ParamsA, ParamsB
path_mapper = PathMapper(item, source="{x;y}", target="{x}")
item_2 = ListItem(List=ccx_2.Points, Index="0", Wrap=True)  # -> flatten(Item)
ccx_3 = CurveCurve(CurveA=crossref_2.ListA, CurveB=crossref_2.ListB)  # -> Points, ParamsA, ParamsB; disabled
null = NullItem(Item=item_2)  # -> NullFlags, InvalidFlags, Description
item_3 = ListItem(List=ccx_3.Points, Index=0, Wrap=True)  # -> flatten(Item); disabled
null_2 = NullItem(Item=path_mapper)  # -> NullFlags, InvalidFlags, Description
dispatch = Dispatch(List=item_2, DispatchPattern=null.NullFlags)  # -> ListA, ListB
index = ItemIndex(List=item_3, Item=item_3)  # disabled
not = GateNot(A=null_2.NullFlags)
index_2 = ItemIndex(List=item_2, Item=dispatch.ListB)
mod = Modulus(A=index, B=number_slider_3)  # disabled
int = Integer(not)
mod_2 = Modulus(A=index_2, B=number_slider)
null_3 = NullItem(Item=mod)  # -> NullFlags, InvalidFlags, Description; disabled
ma = MassAddition(Input=int)  # -> flatten(Result), PartialResults
replace = ReplaceItems(List=divide_2.Points, Item=dispatch.ListB, Indices=mod_2, Wrap=False)
dispatch_2 = Dispatch(List=mod, DispatchPattern=null_3.NullFlags)  # -> ListA, ListB; disabled
dispatch_3 = Dispatch(List=ma.Result, DispatchPattern=ma.Result)  # -> ListA, ListB
pline = PolyLine(Vertices=replace, Closed=True)
replace_2 = ReplaceItems(List=divide_3.Points, Item=flatten(item_3), Indices=mod, Wrap=False)  # disabled
boundary = BoundarySurfaces(Edges=pline)
pt_4 = Point(path_mapper)
pline_2 = PolyLine(Vertices=replace_2, Closed=True)  # disabled
clean = CleanTree(RemoveNulls=True, RemoveInvalid=True, RemoveEmpty=False, Tree=pt_4)  # -> flatten(Tree)
index_3 = ItemIndex(List=ma.Result, Item=dispatch_3.ListA)
boundary_2 = BoundarySurfaces(Edges=pline_2)  # disabled
replace_3 = ReplaceItems(List=divide.Points, Item=clean, Indices=index_3, Wrap=False)
pline_3 = PolyLine(Vertices=replace_3, Closed=True)
boundary_3 = BoundarySurfaces(Edges=pline_3)
