# Grasshopper definition Isovist Mapping.gh (Grasshopper 0.9.76)

u = Slider(20, range=0..20)
x = Slider(20, range=-20..20)
y = Slider(20, range=-20..20)
v = Slider(20, range=0..20)
plane = Plane(PlaneXY(2.137090317, 8.88472494, 0))
rectangle = Rectangle(Plane=plane, XSize=x, YSize=y, Radius=0)  # -> Rectangle, Length
divide_surface = DivideSurface(Surface=rectangle.Rectangle, UCount=u, VCount=v)  # -> flatten(Points), Normals, Parameters

isovist = IsoVist(
    Plane=graft(divide_surface.Points),
    Count=Slider(40, range=0..100),
    Radius=Slider(40, range=0..100),
    Obstacles=[<curve referenced from the Rhino model> x5])  # -> Points, Distance, Index
polyline = PolyLine(Vertices=isovist.Points, Closed=True)
boundary_surfaces = BoundarySurfaces(Edges=polyline)

boundary_surfaces_2 = BoundarySurfaces(Edges=rectangle.Rectangle)
region_intersection = RegionIntersection(CurvesA=boundary_surfaces_2, CurvesB=boundary_surfaces)
panel = Panel("面积取交集")
boundary_surfaces_3 = BoundarySurfaces(Edges=region_intersection)

area = Area(Geometry=boundary_surfaces_3)  # -> flatten(Area), Centroid
del = DelaunayMesh(Points=divide_surface.Points, Plane=PlaneXY(0, 0, 0))

sort_list = SortList(Keys=area.Area)  # -> Keys, ValuesValuesA
_0 = Number(0)
list_item = ListItem(List=reverse(sort_list.Keys), Index=_0, Wrap=True)
list_item_2 = ListItem(List=sort_list.Keys, Index=_0, Wrap=True)

demesh = DeconstructMesh(Mesh=del)  # -> Vertices, Faces, Colours, Normals
gradient = Gradient(
    LowerLimit=list_item_2,
    UpperLimit=list_item,
    Parameter=area.Area,
    stops=[0: RGB(75, 107, 169), 0.255: RGB(173, 203, 249), 0.5: RGB(254, 244, 84), 0.745: RGB(234, 126, 0), 1: RGB(234, 38, 0)])
conmesh = ConstructMesh(Vertices=demesh.Vertices, Faces=demesh.Faces, Colours=gradient)
panel_2 = Panel(gradient)
