# Grasshopper definition Shading with Surrounding Buildings.gh (Grasshopper 0.9.76)
# plug-ins: TT Toolbox

opening_size_z_i = Slider(0.208, range=0..0.25)
# Side Panel (Random)
opening_size_x_i = Slider(0.2, range=0..0.25)
# Side Panel (Normal)
opening_size_o = Slider(0.18, range=0..0.25)
thickness = Slider(0.13, range=0..0.2)
# Slanted Openings
opening_size_x_i_2 = Slider(0.2, range=0..0.25)
# Panel Module Set Up
panel_width = Slider(1.377, range=0..10)
panel_height = Slider(4, range=0..10)
of_rebar_in_x = Slider(5, range=1..10)
of_rebar_in_z = Slider(14, range=1..40)
first_rebar_x = Slider(0, range=0..0.5)
first_rebar_z = Slider(0, range=0..0.5)
# Straight Openings
opening_size_x_i_3 = Slider(0.2, range=0..0.25)
opening_size_z_i_2 = Slider(0.208, range=0..0.25)
opening_size_o_2 = Slider(0.208, range=0..0.25)
shear_x = Slider(0, range=0..0.3)
shear_z = Slider(0, range=0..0.3)

# ----
# Hour of Year (No Leap Year PLS)
year = Slider(2017, range=1970..2050)
hour = Slider(8759, range=0..8759)
gmt_time_zone = Slider(9, range=0..23)

crv = Curve([<curve referenced from the Rhino model> x80])
crv_2 = Curve([<curve referenced from the Rhino model> x168])

# ----
# Site Location
# True North
panel = Panel("35.7")
vec2pt = Vector2Pt(
    PointA=Point(181.2159464, -74.38642528, 350.3097974),
    PointB=Point(-188.3358667, 78.68694767, 350.3097974),
    Unitize=False)  # -> Vector, Length
Z = UnitZ(Factor=1)

# ----
# Panel Starting Corner
pt = Point(<point referenced from the Rhino model>)

# ----
# Excel Update Swtich
toggle = BooleanToggle(False)

division = Division(A=hour, B="24")

# ----
# Blocking Geometry
brep = Brep(simplify(graft([<brep referenced from the Rhino model> x9])))

split = TextSplit(Text=division, Separators=".")
series = Series(Start=0, Step=panel_width, Count=10)
item = ListItem(List=split, Index=0, Wrap=True)
area = Area(Geometry=crv)  # -> Area, Centroid
eval = Evaluate(F="x-y*24", x=hour, y=item)
eval_2 = Evaluate(F="x+1", x=item)
X = UnitX(Factor=series)
X_2 = UnitX(Factor=thickness)
move = Move(Geometry=pt, Motion=X)  # -> Geometry, Transform
doy_date = CSharpScript(DOY=eval_2, Year=year)  # -> out, A, B; inputs DOY: Int32, Year: Int32
# ---------- doy_date: C# ----------
    DateTime date = new DateTime(Year, 1, 1);
    date = date.AddDays(DOY - 1);
    A = date.ToLongDateString();
    B = date.ToShortDateString();
# ---------- end doy_date ----------
rev = Reverse(Vector=X_2)
division_2 = Division(A=opening_size_x_i, B=opening_size_o)
division_3 = Division(A=opening_size_z_i, B=opening_size_o)
move_2 = Move(Geometry=crv_2, Motion=rev)  # -> Geometry, Transform
panel_2 = Panel(doy_date.B)
panel_3 = Panel(eval)
ddate = DeconstructDate(Date=doy_date.B)  # -> Year, Month, Day, Hour, Minute, Second
scale_nu = ScaleNU(Geometry=crv, Plane=area.Centroid, ScaleX=1, ScaleY=division_2, ScaleZ=division_3)  # -> Geometry, Transform
sun_angles = CSharpScript(
    GMT=gmt_time_zone,
    Hour=eval,
    DayOfMonth=ddate.Day,
    Month=ddate.Month,
    Year=ddate.Year,
    Latitude=panel,
    Longitude="139.767",
    North=vec2pt.Vector,
    Up=Z,
    DataComparison="cross_reference")  # -> out, azimuth, altitude, direction; inputs GMT: Int32, Hour: Int32, DayOfMonth: Int32, Month: Int32, Year: Int32, Latitude: Double, Longitude: Double, North: Vector3d, Up: Vector3d
# ---------- sun_angles: C# ----------
    // Implementation in C# by Mikael Nillsson
    // http://guideving.blogspot.nl/2010/08/sun-position-in-c.html
    // Adaptation to Grasshopper By Arend van Waart <Arendvw@gmail.com>
    // Customized Coordinates Code Revised by Weishun Xu <xuweishun@gmail.com>
    // For a discussion of the code see http://stackoverflow.com/questions/8708048/position-of-the-sun-given-time-of-day-latitude-and-longitude

    North.Unitize();
    Up.Unitize();


    DateTime time = new DateTime(Year, Month, DayOfMonth, Hour, 0, 0, DateTimeKind.Utc);
    time = time.AddHours(-GMT);
    this.CalculateSunPosition(time, Latitude, Longitude);
    azimuth = this.azimuth;
    altitude = this.altitude;

    // plane: x = north; y = up
    Point3d p0 = new Point3d(0, 0, 0);
    Point3d origin = new Point3d(0, 0, 0);
    p0.Transform(Transform.Translation(North));
    p0.Transform(Transform.Rotation(-this.azimuth, Up, origin));
    //the positive directions of azimuth measurement and rhino rotations are opposite

    Plane azPlane = new Plane(origin, new Vector3d(p0), Up);
    p0.Transform(Transform.Rotation(this.altitude, azPlane.ZAxis, origin));
    Vector3d dir = new Vector3d(-p0);
    dir.Unitize();
    direction = dir;
# ---------- sun_angles: C# additional code ----------
  private const double Deg2Rad = Math.PI / 180.0;
  private const double Rad2Deg = 180.0 / Math.PI;
  private double altitude;
  private double azimuth;

    /*!
     * \brief Calculates the sun light.
     *
     * CalcSunPosition calculates the suns "position" based on a
     * given date and time in local time, latitude and longitude
     * expressed in decimal degrees. It is based on the method
     * found here:
     * http://www.astro.uio.no/~bgranslo/aares/calculate.html
     * The calculation is only satisfiably correct for dates in
     * the range March 1 1900 to February 28 2100.
     * \param dateTime Time and date in local time.
     * \param latitude Latitude expressed in decimal degrees.
     * \param longitude Longitude expressed in decimal degrees.
     */
  public void CalculateSunPosition(
    DateTime dateTime, double latitude, double longitude)
  {
    // Convert to UTC
    dateTime = dateTime.ToUniversalTime();

    // Number of days from J2000.0.
    double julianDate = 367 * dateTime.Year -
      (int) ((7.0 / 4.0) * (dateTime.Year +
      (int) ((dateTime.Month + 9.0) / 12.0))) +
      (int) ((275.0 * dateTime.Month) / 9.0) +
      dateTime.Day - 730531.5;

    double julianCenturies = julianDate / 36525.0;

    // Sidereal Time
    double siderealTimeHours = 6.6974 + 2400.0513 * julianCenturies;

    double siderealTimeUT = siderealTimeHours +
      (366.2422 / 365.2422) * (double) dateTime.TimeOfDay.TotalHours;

    double siderealTime = siderealTimeUT * 15 + longitude;

    // Refine to number of days (fractional) to specific time.
    julianDate += (double) dateTime.TimeOfDay.TotalHours / 24.0;
    julianCenturies = julianDate / 36525.0;

    // Solar Coordinates
    double meanLongitude = CorrectAngle(Deg2Rad *
      (280.466 + 36000.77 * julianCenturies));

    double meanAnomaly = CorrectAngle(Deg2Rad *
      (357.529 + 35999.05 * julianCenturies));

    double equationOfCenter = Deg2Rad * ((1.915 - 0.005 * julianCenturies) *
      Math.Sin(meanAnomaly) + 0.02 * Math.Sin(2 * meanAnomaly));

    double elipticalLongitude =
      CorrectAngle(meanLongitude + equationOfCenter);

    double obliquity = (23.439 - 0.013 * julianCenturies) * Deg2Rad;

    // Right Ascension
    double rightAscension = Math.Atan2(
      Math.Cos(obliquity) * Math.Sin(elipticalLongitude),
      Math.Cos(elipticalLongitude));

    double declination = Math.Asin(
      Math.Sin(rightAscension) * Math.Sin(obliquity));

    // Horizontal Coordinates
    double hourAngle = CorrectAngle(siderealTime * Deg2Rad) - rightAscension;

    if (hourAngle > Math.PI)
    {
      hourAngle -= 2 * Math.PI;
    }

    this.altitude = Math.Asin(Math.Sin(latitude * Deg2Rad) *
      Math.Sin(declination) + Math.Cos(latitude * Deg2Rad) *
      Math.Cos(declination) * Math.Cos(hourAngle));

    // Nominator and denominator for calculating Azimuth
    // angle. Needed to test which quadrant the angle is in.
    double aziNom = -Math.Sin(hourAngle);
    double aziDenom =
      Math.Tan(declination) * Math.Cos(latitude * Deg2Rad) -
      Math.Sin(latitude * Deg2Rad) * Math.Cos(hourAngle);

    this.azimuth = Math.Atan(aziNom / aziDenom);

    if (aziDenom < 0) // In 2nd or 3rd quadrant
    {
      this.azimuth += Math.PI;
    }
    else if (aziNom < 0) // In 4th quadrant
    {
      this.azimuth += 2 * Math.PI;
    }

    // Altitude
    //Console.WriteLine("Altitude: " + altitude * Rad2Deg);

    // Azimut
    //Console.WriteLine("Azimuth: " + azimuth * Rad2Deg);
  }

    /*!
    * \brief Corrects an angle.
    *
    * \param angleInRadians An angle expressed in radians.
    * \return An angle in the range 0 to 2*PI.
    */
  private static double CorrectAngle(double angleInRadians)
  {
    if (angleInRadians < 0)
    {
      return 2 * Math.PI - (Math.Abs(angleInRadians) % (2 * Math.PI));
    }
    else if (angleInRadians > 2 * Math.PI)
    {
      return angleInRadians % (2 * Math.PI);
    }
    else
    {
      return angleInRadians;
    }
  }
# ---------- end sun_angles ----------
srf = Surface(move_2.Geometry)
panel_4 = Panel(eval)
int = Integer(panel_4)
X_3 = UnitX(Factor=thickness)
pt_2 = ConstructPoint(XCoordinate=0, YCoordinate=0, ZCoordinate=0)
area_2 = Area(Geometry=srf)  # -> flatten(Area), Centroid
eval_3 = Evaluate(F="x+1", x=int)
division_4 = Division(A=thickness, B="-2")

# ----
# Sun Position Validation
panel_5 = Panel(sun_angles.azimuth)
panel_6 = Panel(sun_angles.altitude)
deg = Degrees(Radians=panel_5)
deg_2 = Degrees(Radians=panel_6)
panel_7 = Panel(deg)
panel_8 = Panel(deg_2)

panel_9 = Panel(eval_2)
path = FilePath("C:\Users\1510175\Desktop\KHD\20170602_Environment_Shading\4F\4FL_ShadingRate200208EVON.xlsx")
X_4 = UnitX(Factor=1)
X_5 = UnitX(Factor=1)
move_3 = Move(Geometry=scale_nu.Geometry, Motion=X_3)  # -> Geometry, Transform
filter_night = CSharpScript(angle=sun_angles.direction, altitude=sun_angles.altitude)  # -> out, A; inputs angle: Vector3d, altitude: Double
# ---------- filter_night: C# ----------
    Vector3d angleout = new Vector3d();
    if (altitude < 0)
    {
      angleout.X = 0;
      angleout.Y = 0;
      angleout.Z = 1;
    }
    else
    {
      angleout = angle;
    }
    A = angleout;
# ---------- end filter_night ----------
wo = WriteOptions(
    FilePath=path,
    ClearDataOverwrite=False,
    SaveAfterWrite=True,
    CloseAfterWrite=False,
    ColumnStartPosition=panel_9,
    RowStartPosition=eval_3)  # -> UserMessages, WriteOptions
Y = UnitY(Factor=1)
vec = VectorXYZ(XComponent=first_rebar_x, YComponent=division_4, ZComponent=first_rebar_z)  # -> Vector, Length
rev_2 = Reverse(Vector=X_5)
amp = Amplitude(Vector=[sun_angles.direction, rev_2], Amplitude=Slider(80, range=0..10000))
eval_4 = Evaluate(F="x-2*y", x=panel_width, y=first_rebar_x)
eval_5 = Evaluate(F="x-2*y", x=panel_height, y=first_rebar_z)
vdis = VectorDisplay(Anchor=pt_2, Vector=amp)
division_5 = Division(A=eval_4, B=of_rebar_in_x)
division_6 = Division(A=eval_5, B=of_rebar_in_z)
angle = Angle(VectorA=X_4, VectorB=sun_angles.direction)  # -> Angle, Reflex
move_4 = Move(Geometry=move.Geometry, Motion=vec.Vector)  # -> Geometry, Transform
angle_2 = Angle(VectorA=rev_2, VectorB=sun_angles.direction)  # -> Angle, Reflex
srf_2 = Surface(move_3.Geometry)
angle_3 = Angle(VectorA=Y, VectorB=sun_angles.direction)  # -> Angle, Reflex
xz = XZPlane(Origin=move_4.Geometry)
filter_night_2 = CSharpScript(light=filter_night.A, angle=angle_3.Angle)  # -> out, A; inputs light: Vector3d, angle: Double
# ---------- filter_night_2: C# ----------
    Vector3d lightout = new Vector3d();
    if (angle > 0.5 * Math.PI)
    {
      lightout.X = 0;
      lightout.Y = 0;
      lightout.Z = 1;
    }
    else
    {
      lightout = light;
    }
    A = lightout;
# ---------- end filter_night_2 ----------
filter_night_3 = CSharpScript(light=filter_night.A, angle=angle_2.Angle)  # -> out, A; inputs light: Vector3d, angle: Double; same code as filter_night_2
filter_night_4 = CSharpScript(light=filter_night.A, angle=angle.Angle)  # -> out, A; inputs light: Vector3d, angle: Double; same code as filter_night_2
area_3 = Area(Geometry=srf_2)  # -> flatten(Area), Centroid

# ----
# Rebar Layout
# Rebar Interval X
# Rebar Interval Z
panel_10 = Panel(division_5)
panel_11 = Panel(division_6)
recgrid = Rectangular(Plane=xz, SizeX=division_5, SizeY=division_6, ExtentX=of_rebar_in_x, ExtentY=of_rebar_in_z)  # -> Cells, Points

area_4 = Area(Geometry=recgrid.Cells)  # -> Area, Centroid
cluster = Cluster(
    projected_curves=simplify(graft(scale_nu.Geometry)),
    projection_surface=simplify(graft(srf_2)),
    light=filter_night_4.A,
    G=brep)  # -> E, R, P
cluster_2 = Cluster(projected_curves=simplify(graft(crv_2)), projection_surface=simplify(graft(srf)), light=filter_night_3.A, G=brep)  # -> E, R, P
xz_2 = XZPlane(Origin=area_4.Centroid)  # -> simplify(Plane)
path_mapper = PathMapper(xz_2, source="{a;b}", target="{a}")
bang = ExplodeTree(Data=path_mapper)  # -> Branch0, Branch1, Branch2, Branch3, Branch4, Branch5, Branch6, Branch7, Branch8, Branch9
merge = Merge(Data1=bang.Branch0, Data2=bang.Branch1, Data3=bang.Branch9)
merge_2 = Merge(
    Data1=bang.Branch2,
    Data2=bang.Branch3,
    Data3=bang.Branch4,
    Data4=bang.Branch5,
    Data5=bang.Branch6,
    Data6=bang.Branch7,
    Data7=bang.Branch8)
sheard_panel = SheardPanel(
    P=merge_2,
    thickness=thickness,
    opening_small=opening_size_x_i_2,
    opening_big=opening_size_o_2,
    shear_x=shear_x,
    shear_z=shear_z)  # -> G, G_2
normal_panel = NormalPanel(P=merge, thickness=thickness, opening_x=opening_size_x_i_3, opening_z=opening_size_z_i_2)  # -> G, G_2
merge_3 = Merge(Data1=normal_panel.G_2, Data2=sheard_panel.G_2)
merge_4 = Merge(Data1=normal_panel.G, Data2=sheard_panel.G)
srf_3 = Surface(merge_3)
cluster_3 = Cluster(projected_curves=merge_4, projection_surface=srf_3, light=filter_night_2.A, G=brep)  # -> E, R, P
area_5 = Area(Geometry=srf_3)  # -> flatten(Area), Centroid
ma = MassAddition(Input=flatten([cluster_3.R, cluster_2.R, cluster.R]))  # -> Result, PartialResults
ma_2 = MassAddition(Input=flatten([area_5.Area, area_2.Area, area_3.Area]))  # -> Result, PartialResults
division_7 = Division(A=ma.Result, B=ma_2.Result)
eval_6 = Evaluate(F="1-x", x=division_7)

# ----
# ある時点直射光軽減率
# ある時点直射光率
panel_12 = Panel(division_7)
panel_13 = Panel(eval_6)

writexl = WriteToExcel(Run=toggle, ExcelWorksheet="1", WriteOptions=wo.WriteOptions, ColumnnsOrRows=False, DataToWriteIntoColumns=panel_13)

# ==== cluster SheardPanel
opening_small = ClusterInput()
opening_big = ClusterInput()
thickness = ClusterInput()
shear_x = ClusterInput()
shear_z = ClusterInput()
P = ClusterInput()
opening_small_2 = Number(opening_small)
opening_big_2 = Number(opening_big)
thickness_2 = Number(thickness)
shear_x_2 = Number(shear_x)
shear_z_2 = Number(shear_z)
division = Division(A=opening_small_2, B="2")
division_2 = Division(A=opening_small_2, B="2")
division_3 = Division(A=thickness_2, B="-2")
neg = Negative(Value=division)
neg_2 = Negative(Value=division_2)
dom = ConstructDomain(DomainStart=neg, DomainEnd=division)
dom_2 = ConstructDomain(DomainStart=neg_2, DomainEnd=division_2)

# ----
# Tokyo Critical Angle: Z
panel = Panel("pi/6")
tan = Tangent(Value=panel)
multiplication = Multiplication(A=thickness_2, B=tan)
subtraction = Subtraction(A=opening_small_2, B=multiplication)
min = Minimum(A=shear_z_2, B=subtraction)
panel_2 = Panel(min)

# ----
# Opening Layout
rectangle = Rectangle(Plane=P, XSize=dom, YSize=dom_2, Radius=0)  # -> simplify(Rectangle), Length

division_4 = Division(A=shear_x_2, B="2")
division_5 = Division(A=min, B="-2")
vec = VectorXYZ(XComponent=division_4, YComponent=division_3, ZComponent=division_5)  # -> Vector, Length
rev = Reverse(Vector=vec.Vector)
move = Move(Geometry=rectangle.Rectangle, Motion=rev)  # -> Geometry, Transform
disc = Discontinuity(Curve=move.Geometry, Level=1)  # -> simplify(Points), Parameters
move_2 = Move(Geometry=rectangle.Rectangle, Motion=vec.Vector)  # -> Geometry, Transform
item = ListItem(List=disc.Points, Index=1, Wrap=True)
division_6 = Division(A=opening_big_2, B=opening_small_2)
G = ClusterOutput(move_2.Geometry)
path_mapper = PathMapper(item, source="{a;b}", target="{a}")
scale = Scale(Geometry=move.Geometry, Center=path_mapper, Factor=division_6)  # -> Geometry, Transform
G_2 = ClusterOutput(scale.Geometry)

# ==== cluster NormalPanel
opening_x = ClusterInput()
opening_z = ClusterInput()
thickness = ClusterInput()
P = ClusterInput()
opening_z_2 = Number(opening_z)
opening_x_2 = Number(opening_x)
thickness_2 = Number(thickness)
division = Division(A=opening_x_2, B="2")
division_2 = Division(A=opening_z_2, B="2")
division_3 = Division(A=thickness_2, B="-2")
neg = Negative(Value=division)
neg_2 = Negative(Value=division_2)
Y = UnitY(Factor=division_3)
dom = ConstructDomain(DomainStart=neg, DomainEnd=division)
dom_2 = ConstructDomain(DomainStart=neg_2, DomainEnd=division_2)

# ----
# Opening Layout
rectangle = Rectangle(Plane=P, XSize=dom, YSize=dom_2, Radius=0)  # -> simplify(Rectangle), Length

rev = Reverse(Vector=Y)
move = Move(Geometry=rectangle.Rectangle, Motion=Y)  # -> Geometry, Transform
move_2 = Move(Geometry=rectangle.Rectangle, Motion=rev)  # -> Geometry, Transform
G = ClusterOutput(move.Geometry)
G_2 = ClusterOutput(move_2.Geometry)

# ==== cluster Cluster
projection_surface = ClusterInput()
projected_curves = ClusterInput()
light = ClusterInput()
projection_surface_2 = Surface(projection_surface)
projected_curves_2 = Curve(projected_curves)
light_2 = Vector(light)
project = Project(Curve=simplify(graft(projected_curves_2)), Brep=simplify(graft(projection_surface_2)), Direction=light_2)  # -> flatten(Curve)
rev = Reverse(Vector=light_2)
explode = Explode(Curve=project, Recursive=True)  # -> Segments, Vertices
G = ClusterInput()
item = ListItem(List=explode.Segments, Index=0, Wrap=True)
item_2 = ListItem(List=explode.Segments, Index=1, Wrap=True)
extrcrv = ExtrudeAlong(Base=item, Curve=item_2)
area = Area(Geometry=extrcrv)  # -> Area, Centroid
project_2 = ProjectPoint(Point=flatten(area.Centroid), Direction=rev, Geometry=G)  # -> simplify(Point), Index
flip = FlipMatrix(Data=project_2.Point)
null = NullItem(Item=flip)  # -> NullFlags, InvalidFlags, Description
dispatch = Dispatch(List=flip, DispatchPattern=null.NullFlags)  # -> ListA, ListB
lng = ListLength(List=dispatch.ListB)
not = GateNot(A=lng)
multiplication = Multiplication(A=area.Area, B=not)
ma = MassAddition(Input=flatten(multiplication))  # -> Result, PartialResults
E = ClusterOutput(extrcrv)
R = ClusterOutput(ma.Result)
P = ClusterOutput(project_2.Point)
