# Grasshopper definition Lissajous Curve.gh (Grasshopper 0.9.76)

number_slider = Slider(200, range=1..200)
pi = Pi(Factor="2")
division = Division(A=pi, B=number_slider)
series = Series(Start=0, Step=division, Count=number_slider)
multiplication = Multiplication(A=series, B=Slider(9, range=1..10))
multiplication_2 = Multiplication(A=series, B=Slider(7, range=1..10))
sin = Sine(Value=multiplication_2)
cos = Cosine(Value=multiplication)
pt = ConstructPoint(XCoordinate=sin, YCoordinate=cos, ZCoordinate=0)
intcrv = Interpolate(Vertices=pt, Degree=3, Periodic=False, KnotStyle=1)  # -> Curve, Length, Domain
