# Grasshopper definition Mesh Relaxing.gh (Grasshopper 0.9.76)
# plug-ins: Kangaroo Components, Weaverbird

new_mesh = Mesh(<mesh referenced from the Rhino model>)
wbnaked = WeaverbirdsNakedBoundary(MeshClosedPolylines=new_mesh)
item = ListItem(List=reverse(wbnaked), Index=0, Wrap=True)
item_2 = ListItem(List=wbnaked, Index=0, Wrap=True)
explode = Explode(Curve=item, Recursive=True)  # -> Segments, Vertices
wbedges = WeaverbirdsMeshEdges(MeshOrPolylines=new_mesh)
explode_2 = Explode(Curve=item_2, Recursive=True)  # -> Segments, Vertices
pt = Point(explode.Vertices)
len = Length(Curve=wbedges)
multiplication = Multiplication(A=len, B=Slider(0, range=0..1))
springs = SpringsFromLine(Connection=wbedges, Stiffness=1000, Damping=10, RestLength=multiplication, UpperCutoff=0, LowerCutoff=0, Plasticity=0)
timer = Timer(TimerInterval=50, Target=kangaroo)  # disabled
kangaroo = KangarooPhysics(
    ForceObjects=flatten(springs),
    AnchorPoints=flatten([explode_2.Vertices, pt]),
    Settings=null,
    Geometry=flatten(new_mesh),
    SimulationReset=Toggle(True))  # -> Out, Iterations, ParticlesOut, GeometryOut
mesh = Mesh(kangaroo.GeometryOut)
