# Grasshopper definition Nichiei.gh (Grasshopper 0.9.76)
# plug-ins: Python Interpreter

ladybug = Ladybug_Ladybug()  # -> Vviiiiiiiiiizzz; plug-in component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
# STEP 1
path = FilePath("C:\Users\1510175\Desktop\Global References\01_Climate_Data\03_epw_Tokyo Standard Year\Tokyo_Tokyo_Std_EAD.epw")
number_slider = Slider(3000, range=0..10000)

# ----
# 平均地盤面高さ
# STEP 3
number_slider_2 = Slider(3000, range=0..10000)
# 平均地盤面から高さ
panel = Panel("1500")

# ----
# Volume(polysurf)
# STEP 2
brep = Brep(graft(<brep referenced from the Rhino model>))
panel_2 = Panel("4500")
# Cutting Plane
srf = Surface(<surface referenced from the Rhino model>)
importepw = Ladybug_ImportEpw(epwFile=path)  # -> readMe, latitude, location, dryBulbTemperature, dewPointTemperature, relativeHumidity, windSpeed, windDirection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; plug-in component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
series = Series(Start=0, Step=1, Count=24)
xy = XYPlane(Origin=Point(0, 0, 0))
addition = Addition(A=number_slider_2, B=panel)
Z = UnitZ(Factor=addition)
move = Move(Geometry=srf, Motion=Z)  # -> Geometry, Transform
move_2 = Move(Geometry=xy, Motion=Z)  # -> Geometry, Transform
sunpath = Ladybug_SunPath(location=importepw.location, hour=series, day="12", month="6", timeStep=1, dailyOrAnnualSunPath=True)  # -> readMe, sunVectors, sunAltitudes, sunAzimuths, port, sunSpheresMesh, sunPathCrvs, legend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; plug-in component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
split = SplitBrep(Brep=brep, Cutter=move.Geometry)
cap = CapHoles(Brep=split)
volume = Volume(Geometry=cap)  # -> Volume, Centroid
pdecon = Deconstruct(Point=volume.Centroid)  # -> XComponent, YComponent, ZComponent
panel_3 = Panel(sunpath.sunVectors)
larger = LargerThan(FirstNumber=pdecon.ZComponent, SecondNumber=addition)  # -> LargerThan, OrEqualTo
dispatch = Dispatch(List=cap, DispatchPattern=larger.LargerThan)  # -> ListA, ListB
mesh = MeshBrep(
    Brep=dispatch.ListA,
    Settings={GridMaxCount=0, GridMinCount=16, JaggedSeams=False, MaxEdgeLength=0, MinEdgeLength=0.0001, MinTolerance=0, Refine=True, RefineAngle=0, RelativeTolerance=0.65, SimplePlanes=True, Tolerance=0})
mshadow = MeshShadow(Mesh=mesh, Light=sunpath.sunVectors, Plane=move_2.Geometry)
txt = Text(sunpath.sunPositionsInfo)
disc = Discontinuity(Curve=mshadow, Level=1)  # -> Points, Parameters
item = ListItem(List=disc.Points, Index="2", Wrap=True)  # -> simplify(flatten(Item))
path_mapper = PathMapper(item, source="{a;b}", target="{a}")
tag = TextTag3D(Location=item, Text=txt, Size=Slider(1000, range=0..1000), Justification=7)
