# Grasshopper definition tree.gh (Grasshopper 0.9.76)
# plug-ins: Anemone

# Seeds of the Trees
pt = Point(simplify(<point referenced from the Rhino model>))
lng = ListLength(List=pt)
dom = ConstructDomain(DomainStart=-1, DomainEnd=1)
number_slider = Slider(4, range=0..10)
number_slider_2 = Slider(0.1, range=0..1)
random = Random(Range=dom, Number=lng, Seed=Slider(33, range=0..100))  # -> simplify(Random)
random_2 = Random(Range=dom, Number=lng, Seed=Slider(71, range=0..100))  # -> simplify(Random)
random_3 = Random(Range=Domain(0, 1), Number=lng, Seed=Slider(20, range=0..100))  # -> simplify(Random)
multiplication = Multiplication(A=random_2, B=number_slider_2)
multiplication_2 = Multiplication(A=random, B=number_slider_2)
multiplication_3 = Multiplication(A=random_3, B=number_slider)
vec = VectorXYZ(XComponent=multiplication, YComponent=multiplication_2, ZComponent="1")  # -> Vector, Length
multiplication_4 = Multiplication(A=multiplication_3, B=Slider(0.2, range=0..1))
addition = Addition(A=number_slider, B=multiplication_4)
# Initial Tree Trunks
line = LineSDL(Start=pt, Direction=vec.Vector, Length=addition)  # -> simplify(graft(Line))

# ----
# Loop Control Here!
number_slider_3 = Slider(3, range=0..5)

dom_2 = ConstructDomain(DomainStart=-1, DomainEnd=1)
# Looping Components
number_slider_4 = Slider(1.7, range=0..2)
number_slider_5 = Slider(0.51, range=0..2)
colour = ColourPicker(PickedColour=RGB(239, 182, 211))
colour_2 = ColourPicker(PickedColour=RGB(87, 71, 40))

loop_start = LoopStart(N=number_slider_3, T=Toggle(True), D0=line, D1=line)  # -> port, Counter, Data, Data_2

line_2 = Line(loop_start.Data)

# ----
# Branching Position
panel = Panel("""0.2
0.35
0.55
0.65
0.8
1""")
eval = EvaluateCurve(Curve=line_2, Parameter=panel)  # -> Point, Tangent, Angle

end = EndPoints(Curve=line_2)  # -> Start, End
lng_2 = ListLength(List=eval.Point)
lng_3 = ListLength(List=lng_2)
ma = MassAddition(Input=flatten(lng_3))  # -> Result, PartialResults
random_4 = Random(Range="100", Number=ma.Result, Seed=2)  # -> simplify(graft(Random))
addition_2 = Addition(A=random_4, B=Slider(6, range=0..10))
addition_3 = Addition(A=random_4, B=Slider(1, range=0..10))
pt_2 = Point(eval.Point)
vec2pt = Vector2Pt(PointA=end.Start, PointB=end.End, Unitize=False)  # -> Vector, Length
random_5 = Random(Range=dom_2, Number=lng_2, Seed=addition_2)
random_6 = Random(Range=dom_2, Number=lng_2, Seed=addition_3)
pdecon = Deconstruct(Point=pt_2)  # -> XComponent, YComponent, ZComponent
sort = SortList(Keys=flatten(pdecon.ZComponent))  # -> Keys, ValuesA
addition_4 = Addition(A=random_4, B=Slider(4, range=0..10))
unit = UnitVector(Vector=vec2pt.Vector)
item = ListItem(List=sort.Keys, Index=0, Wrap=True)
item_2 = ListItem(List=reverse(sort.Keys), Index=0, Wrap=True)
amp = Amplitude(Vector=unit, Amplitude=number_slider_4)
random_7 = Random(Range=vec2pt.Length, Number=lng_2, Seed=addition_4)
subtraction = Subtraction(A=pdecon.ZComponent, B=item)
division = Division(A=subtraction, B=item_2)
multiplication_5 = Multiplication(A=random_5, B=number_slider_5)
multiplication_6 = Multiplication(A=vec2pt.Length, B=Slider(0.65, range=0..1))
multiplication_7 = Multiplication(A=random_6, B=number_slider_5)
multiplication_8 = Multiplication(A=random_7, B=Slider(0.1, range=0..1))
pdecon_2 = Deconstruct(Point=amp)  # -> XComponent, YComponent, ZComponent
multiplication_9 = Multiplication(A=division, B=Slider(0.5, range=0..1))
addition_5 = Addition(A=multiplication_6, B=multiplication_8)
# Tree Branch Directions
addition_6 = Addition(A=pdecon_2.XComponent, B=multiplication_5)
addition_7 = Addition(A=pdecon_2.YComponent, B=multiplication_7)
# Branch Growth Length Control
subtraction_2 = Subtraction(A=addition_5, B=multiplication_9)
vec_2 = VectorXYZ(XComponent=addition_6, YComponent=addition_7, ZComponent=pdecon_2.ZComponent)  # -> simplify(Vector), Length
line_3 = LineSDL(Start=pt_2, Direction=vec_2.Vector, Length=subtraction_2)  # -> simplify(graft(Line))
line_4 = Line(loop_start.Data_2)
merge = Merge(Data1=flatten(line_3), Data2=flatten(line_4))  # -> simplify(graft(Result))
end_2 = EndPoints(Curve=line_3)  # -> Start, End
preview = CustomPreview(Geometry=end_2.End, Shader=colour)

loop_end = LoopEnd(port=loop_start.port, Exit=False, Data=line_3, Data_2=merge, pausedState=False, state="Constant output", TimeOutVal=0)  # -> D0, D1

preview_2 = CustomPreview(Geometry=loop_end.D1, Shader=colour_2)
